# Grasshopper definition vizualize_pnts.ghx (Grasshopper 1.0.7)
# plug-ins: Karamba3D, Human

# ----
# 170,469 is the total number of points
# for R1 work volume at 0.1m spacing
# x: -3.2 --> 6.0
# y: 0.3 --> 4.9
# z: -0.4 --> 3.4
# 
# 170,469 is the total number of points
# for R2 work volume at 0.1m spacing
# x: -3.2 --> 6.0
# y: -1.5 --> 3.1
# z: -0.4 --> 3.4
# 
# 162,240 is the total number of points
# for R3 work volume at 0.1m spacing
# x: 1.7 --> 8.0
# y: -1.5 --> 4.9
# z: -0.4 --> 3.4
# 
# 286,455 is the total number of points
# for 3 robot work volume at 0.1m spacing
# x: -3.2 --> 8.0
# y: -1.5 --> 4.9
# z: -0.4 --> 3.4
panel = Panel("results_planar_arches")
panel_2 = Panel("/Users/edvard/Documents/github/rob_fab_reach/_data_track")
cumulative_steps = Slider(100, range=1..100)
list = ValueList({"Robot 1": "rob1", "Robot 2": "rob2", "Robot 3": "rob3", "Robot 1&2": "rob1,rob2", "Robot 1&3": "rob1,rob3", "Robot 2&3": "rob2,rob3", "Robot 1&2&3": "rob1,rob2,rob3"}, selected="Robot 1&2")

angle = Slider(20, range=0..45)
width = Slider(10, range=0..10)
aspect_ratio = Slider(0.6, range=0.1..2)
pt = Point(Point(4.047665691, 1.724886209, -0.3))

# ----
# single direction reachability
number_slider = Slider(50, range=1..100)

# ----
# 'n' robots reach
# (0 and 1, equivalent to No/Yes)
# (2 and 3, if you are reading in data for 2 or 3 robs)
number_slider_2 = Slider(3, range=0..3)
data = Data(panel_2)
data_2 = Data("{}/{}_vec{:0>3}.json")
data_3 = Data(list)
data_4 = Data(number_slider)
python = GhPythonScript(path=data, name=data_2, rob_num=data_3, step_num=data_4, read_data=Toggle(False))  # -> points, values, vector; inputs step_num: Int32
# ---------- python: Python ----------
import os
import json
from compas_fab.utilities import read_data_from_json
from compas_fab.robots import Configuration


def initialize_count(rob_num):
    
    point_count = {}
    
    for rob in rob_num:
        print rob
        filename = name.format(rob,rob,1) # just take first to init
        filepath = os.path.join(path, filename)
        
        print filepath
        
        with open(filepath, "r") as f:
            file_data = f.read()
            
        f.close()
        
        data = json.loads(file_data)
        point_count.update(data['results'])
        
        print len(point_count)
        
    for key in point_count:
        point_count[key] = 0
    
    return point_count


if read_data:
    
    rob_num = rob_num.split(",")
    point_count = initialize_count(rob_num)
    
    for rob in rob_num:
        print "read", rob
        filename = name.format(rob,rob,step_num)
        filepath = os.path.join(path, filename)
    
        with open(filepath, "r") as f:
            file_data = f.read()
            data = json.loads(file_data)
            f.close()
        
        for pnt,result in data['results'].items():
            if result:
                point_count[pnt] += 1
                    
    vector = data['vector']
    points = point_count.keys()
    values = point_count.values()
# ---------- end python ----------

# ----
# cumulative reachability - total
toggle = BooleanToggle(True)
data_5 = Data(panel_2)
data_6 = Data("{}/_{}_TOTAL.json")
data_7 = Data(list)
python_2 = GhPythonScript(path=data_5, name=data_6, rob_num=data_7, read_data=toggle)  # -> points, values, coop_points, simplify(vectors)
# ---------- python_2: Python ----------
import os
import json
from compas_fab.utilities import read_data_from_json
from compas_fab.robots import Configuration

from copy import deepcopy

import ghpythonlib.treehelpers as th

"""


243,360 is the total number of points
for 3 robot work volume at 0.1m spacing
x: -1.5 --> 8.0
y: -1.5 --> 4.9
z: -0.4 --> 3.4
"""

def count_data(rob_num):
    count_total = {}
    count_cooperative = {}
    
    #read in data based on how many robots
    filepaths = [os.path.join(path, name.format(rob,rob)) for rob in rob_num]
    files = [open(filepath, "r") for filepath in filepaths]
    datas = [json.loads(file.read()) for file in files]
    
    for f in files:
        f.close()
    
    #initialize the dictionary, each unique point
    for data in datas:
        count_total.update(data['results'])
    
    #zero all the values in the dictionary
    for key in count_total:
        count_total[key] = 0
        
    count_cooperative = count_total.copy()
    
    #read in all data, sum in total count, sum in # robs reached
    for data in datas:
        for key,value in data['results'].items():
            
            if value:
                count_total[key] += value
                count_cooperative[key] += 1


    return count_total, count_cooperative



if read_data:
    rob_num = rob_num.split(",")
    
    count_total,count_cooperative = count_data(rob_num)
    
    #else: only show points where all robots can reach
    #if comment out the else, then show points where at least 1 can reach
    for key,value in count_cooperative.items():
        if value == len(rob_num):
            count_cooperative[key] = 1
#        else:
#            count_cooperative[key] = 0
    
    points = count_total.keys()
    values = count_total.values()
    coop_points = count_cooperative.values()
    
    #    vectors = th.list_to_tree(vectors, source=[0,0])
# ---------- end python_2 ----------

# ----
# cumulative reachability - one by one
toggle_2 = BooleanToggle(False)
data_8 = Data(panel_2)
data_9 = Data("{}/{}_vec{:0>3}.json")
data_10 = Data(list)
data_11 = Data(cumulative_steps)
python_3 = GhPythonScript(path=data_8, name=data_9, rob_num=data_10, step_num=data_11, read_data=toggle_2)  # -> points, values, coop_points, simplify(vectors); inputs step_num: Int32
# ---------- python_3: Python ----------
import os
import json
from compas_fab.utilities import read_data_from_json
from compas_fab.robots import Configuration

import ghpythonlib.treehelpers as th

"""
243,360 is the total number of points
for 3 robot work volume at 0.1m spacing
x: -1.5 --> 8.0
y: -1.5 --> 4.9
z: -0.4 --> 3.4
"""

def initialize_count(rob_num):
    """return a dictionary full of 0s"""
    
    point_count = {}
    
    for rob in rob_num:
        filename = name.format(rob,rob,1) # just take first to init
        filepath = os.path.join(path, filename)
        
        with open(filepath, "r") as f:
            file_data = f.read()
            
        f.close()
        
        data = json.loads(file_data)
        point_count.update(data['results'])
        
        print len(point_count)
        
    for key in point_count:
        point_count[key] = 0
    
    return point_count

    

if read_data:
    
    rob_num = rob_num.split(",")
    
    point_count = initialize_count(rob_num)
    cooperative_count_save = point_count.copy()
    cooperative_count_zero = point_count.copy()
    vectors = []
    
        
    for i in range(1,step_num+1):
        
        # re-zero it
        cooperative_count = cooperative_count_zero.copy()

        for rob in rob_num:
            print "{}: vector {}".format(rob,i)
            
            filename = name.format(rob,rob,i)
            filepath = os.path.join(path, filename)
            
            with open(filepath, "r") as f:
                file_data = f.read()
                data = json.loads(file_data)
                f.close()
                
                vec = data['vector']
                vectors.append(vec)
            
            for pnt,result in data['results'].items():
                if result:
                    cooperative_count[pnt] += 1
                    point_count[pnt] += 1
                    
        #after all robs done
        #keep over-writing if already 1, then stays 1
        for pnt,result in cooperative_count.items():
            if result == len(rob_num):
                cooperative_count_save[pnt] = 1
            
    #output data
    vectors = th.list_to_tree(vectors, source=[0,0])
    points = point_count.keys()
    values = point_count.values()
    
    coop_points = cooperative_count_save.values()
# ---------- end python_3 ----------
num = Number(python_3.vectors)

# ----
# SINGLE ARCH
division = Division(A=graft(width), B=2)
rad = Radians(Degrees=graft(angle))
multiplication = Multiplication(A=division, B=graft(aspect_ratio))
X = UnitX(Factor=expr("-x", division))
Z = UnitZ(Factor=multiplication)
X_2 = UnitX(Factor=division)
move = Move(Geometry=pt, Motion=Z)  # -> Geometry, Transform
X_3 = UnitX(Factor=-1)
move_2 = Move(Geometry=pt, Motion=[X_2, X])  # -> Geometry, Transform
rot3d = Rotate3D(Geometry=move.Geometry, Angle=rad, Center=pt, Axis=X_3)  # -> Geometry, Transform
item = ListItem(List=move_2.Geometry, Index=0, Wrap=True)  # -> Item, Item1
merge = Merge(Data1=item.Item, Data2=rot3d.Geometry, Data3=item.Item1)

aspect_ratio_2 = Panel("""0.25
0.50
0.75
1.00
1.50
2.00""")
angles = Panel("""0
15
30
45""")
widths = Panel("""2
3
4
5
6
7""")
python_4 = GhPythonScript(p=pt, angles=angles, widths=widths, ratios=aspect_ratio_2)  # -> simplify(points_out), simplify(variables_out); inputs p: Point3d, angles: list, widths: list, ratios: list
# ---------- python_4: Python ----------
__author__ = "Edvard"
__version__ = "2023.06.12"

import rhinoscriptsyntax as rs
import ghpythonlib.treehelpers as th
from Rhino.Geometry import Vector3d

import math
from copy import deepcopy

width_sublist = [[] for i in range(len(widths))]
point_sets = [deepcopy(width_sublist) for i in range(len(angles))]
data_sets = deepcopy(point_sets)

print point_sets


for i,angle in enumerate(angles):
    for j,width in enumerate(widths):
        for ratio in ratios:
            v1 = Vector3d(0,0,0)
            v2 = Vector3d(-width,0,0)
            
            #make end points
            p_start= rs.CopyObject(p,v1)
            p_end = rs.CopyObject(p,v2)
            
            height = (width/2)*ratio
            
            v3 = Vector3d(-width/2,0,height)
            p_mid = rs.CopyObject(p,v3)
            
            p_mid_new = rs.RotateObject(p_mid,p,angle,axis=Vector3d(-1,0,0),copy=True)
            
            point_set = [p_start, p_mid_new, p_end]
            point_sets[i][j].append(point_set)
            data_sets[i][j].append([angle,width,ratio])
            
            

#print point_sets
print data_sets
points_out = th.list_to_tree(point_sets)
variables_out = th.list_to_tree(data_sets)
# ---------- end python_4 ----------

# ----
# if TRUE then show all for variable
number_slider_3 = Slider(4, range=0..10)
ratio_idx = Slider(4, range=0..10)
python_5 = GhPythonScript(
    angle_idx=Slider(3, range=0..10),
    angle_filter=Toggle(False),
    width_idx=number_slider_3,
    width_filter=Toggle(False),
    ratio_idx=ratio_idx,
    ratio_filter=Toggle(False))  # -> out, path; inputs angle_idx: Int32, width_idx: Int32, ratio_idx: Int32
# ---------- python_5: Python ----------
__author__ = "Edvard"
__version__ = "2023.06.12"

import rhinoscriptsyntax as rs

if angle_filter:
    i = "?"
else:
    i = angle_idx
    

if width_filter:
    j = "?"
else:
    j = width_idx
    
    
if ratio_filter:
    k = "?"
else:
    k = ratio_idx
    

path = "{{{};{};{}}}".format(i,j,k)

print path
# ---------- end python_5 ----------

int = Integer(number_slider_2)
mindex = MemberIndex(Set=python.values, Member=int)  # -> Index, Count
dispatch = Dispatch(List=python.points, DispatchPattern=python.values)  # -> ListA, ListB
item_2 = ListItem(List=python.points, Index=mindex.Index, Wrap=True)

list_2 = ValueList({"From One-by-One": 0, "From Total": 1}, selected="From Total")
filter = StreamFilter(Gate=list_2, Stream0=python_3.points, Stream1=python_2.points)
filter_2 = StreamFilter(Gate=list_2, Stream0=python_3.values, Stream1=python_2.values)
filter_3 = StreamFilter(Gate=list_2, Stream0=python_3.coop_points, Stream1=python_2.coop_points)
pt_2 = Point(filter)
int_2 = Integer(filter_2)
int_3 = Integer(filter_3)

int_4 = Integer(int_2)
data_12 = Data(cumulative_steps)
data_13 = Data(list)
values = GhPythonScript(rob_num=data_13, values=int_4, n_steps=data_12)  # -> max_index, max_counts, counts; inputs values: list, n_steps: Int32
# ---------- values: Python ----------
counts = []

rob_num = rob_num.split(",")

# maximum number of possible reaches per point
max = n_steps * len(rob_num)

# count how many times a number of reaches occurs
for i in range(0,max + 1):
    counts.append(values.count(i))

# what is the maximum number of reaches in whole volume
for i,cnt in enumerate(counts):
    if cnt:
        max_index = i

# for many points does maximum number of reaches occur
max_counts = counts[max_index]
# ---------- end values ----------
panel_3 = Panel(values.counts)
panel_4 = Panel(values.max_index)
panel_5 = Panel(values.max_counts)
rec = DataRecorder(panel_5, DataLimit=-10, RecordData=False)
panel_6 = Panel(rec)

# ----
# 3D GRID OF ARCHES
panel_7 = Panel(python_5.path)
pt_3 = Point(python_4.points_out)
viewer = ParamViewer(python_4.points_out)
split = SplitTree(Data=python_4.variables_out, Masks=flatten(python_5.path))  # -> Positive, Negative
split_2 = SplitTree(Data=python_4.points_out, Masks=flatten(python_5.path))  # -> Positive, Negative
viewer_2 = ParamViewer(split_2.Positive)

# ----
# View Reach Vector
item_3 = ListItem(List=python.vector, Index=0, Wrap=True)  # -> Item, Item1, Item2
panel_8 = Panel(python.vector)
pt_4 = ConstructPoint(XCoordinate=0, YCoordinate=-5, ZCoordinate=0)
vec = VectorXYZ(XComponent=item_3.Item, YComponent=item_3.Item1, ZComponent=item_3.Item2)  # -> Vector, Length
vdisex = VectorDisplayEx(Point=pt_4, Vector=vec.Vector, Colour=ColourSwatch(SwatchColor=RGB(252, 167, 167)), Width="8")

# ----
# YES reach
lng = ListLength(List=dispatch.ListA)
panel_9 = Panel(lng)
preview = CustomPreview(Geometry=dispatch.ListA, Material=ColourSwatch(SwatchColor=RGB(0, 34, 255)))

# ----
# NO reach
lng_2 = ListLength(List=dispatch.ListB)
panel_10 = Panel(lng_2)
preview_2 = CustomPreview(Geometry=dispatch.ListB, Material=ColourSwatch(SwatchColor=RGB(0, 0, 0)))

# ----
# 'n' robot reach
lng_3 = ListLength(List=item_2)
panel_11 = Panel(lng_3)
preview_3 = CustomPreview(Geometry=item_2, Material=ColourSwatch(SwatchColor=RGB(250, 12, 12)))

# ----
# See all points
panel_12 = Panel(panel_4)
gradient = Gradient(
    LowerLimit="0",
    UpperLimit=panel_12,
    Parameter=int_2,
    stops=[0: RGB(255, 255, 255), 0.1: RGB(236, 27, 60), 0.2: RGB(210, 0, 118), 0.3: RGB(103, 0, 120), 0.4: RGB(39, 72, 161), 0.5: RGB(1, 192, 229), 0.6: RGB(18, 178, 90), 0.7: RGB(79, 186, 8), 0.8: RGB(220, 237, 32), 0.9: RGB(247, 159, 20), 1: RGB(243, 57, 0)])
gradient_2 = Gradient(
    LowerLimit="0",
    UpperLimit=panel_12,
    Parameter=int_2,
    stops=[0: RGB(255, 255, 255), 0.8: RGB(255, 0, 0), 0.986: RGB(145, 0, 0), 1: RGB(0, 0, 0)])
preview_4 = CustomPreview(Geometry=pt_2, Material=gradient)  # disabled

# ----
# See points with a specified number of reaches
panel_13 = Panel("0")
int_5 = Integer(panel_13)
mindex_2 = MemberIndex(Set=int_2, Member=int_5)  # -> Index, Count
item_4 = ListItem(List=pt_2, Index=mindex_2.Index, Wrap=True)
preview_5 = CustomPreview(Geometry=item_4, Material=ColourSwatch(SwatchColor=RGB(0, 34, 255)))  # disabled

# ----
# See points with a specified % of maximum reaches
panel_14 = Panel(panel_4)
multiplication_2 = Multiplication(A=panel_14, B=Slider(1, range=0..1))
larger = LargerThan(FirstNumber=int_2, SecondNumber=multiplication_2)  # -> LargerThan, OrEqualTo
dispatch_2 = Dispatch(List=pt_2, DispatchPattern=larger.OrEqualTo)  # -> ListA, ListB
preview_6 = CustomPreview(Geometry=dispatch_2.ListA, Material=ColourSwatch(SwatchColor=RGB(217, 80, 80)))  # disabled

# ----
# See points with 100% of maximum reaches
panel_15 = Panel(panel_4)
int_6 = Integer(panel_15)
mindex_3 = MemberIndex(Set=int_2, Member=int_6)  # -> Index, Count
item_5 = ListItem(List=pt_2, Index=mindex_3.Index, Wrap=True)
preview_7 = CustomPreview(Geometry=item_5, Material=ColourSwatch(SwatchColor=RGB(0, 0, 0)))  # disabled

flip = FlipMatrix(Data=num)
branch = TreeBranch(Tree=flip, Path="{1}", MaintainPaths=True)
branch_2 = TreeBranch(Tree=flip, Path="{2}", MaintainPaths=True)
branch_3 = TreeBranch(Tree=flip, Path="{0}", MaintainPaths=True)
pt_5 = ConstructPoint(XCoordinate=6, YCoordinate=-3, ZCoordinate=0)
vec_2 = VectorXYZ(XComponent=branch_3, YComponent=branch, ZComponent=branch_2)  # -> Vector, Length
vdisex_2 = VectorDisplayEx(Point=pt_5, Vector=vec_2.Vector, Colour=RGB(0, 0, 0), Width="1")

# ----
# See points where there is cooperative reach (multi robots can reach)
dispatch_3 = Dispatch(List=pt_2, DispatchPattern=int_3)  # -> ListA, ListB
dispatch_4 = Dispatch(List=int_2, DispatchPattern=int_3)  # -> ListA, ListB
panel_16 = Panel(panel_4)
gradient_3 = Gradient(
    LowerLimit="0",
    UpperLimit=panel_16,
    Parameter=dispatch_4.ListA,
    stops=[0: RGB(255, 255, 255), 0.1: RGB(236, 27, 60), 0.2: RGB(210, 0, 118), 0.3: RGB(103, 0, 120), 0.4: RGB(39, 72, 161), 0.5: RGB(1, 192, 229), 0.6: RGB(18, 178, 90), 0.7: RGB(79, 186, 8), 0.8: RGB(220, 237, 32), 0.9: RGB(247, 159, 20), 1: RGB(243, 57, 0)])
pt_6 = Point(dispatch_3.ListA)
preview_8 = CustomPreview(Geometry=pt_6, Material=gradient_3)  # disabled

# ----
# R1
panel_17 = Panel("{6.0,0.3,3.4}")
# visualize volumes
# search domain, diagonal corners
panel_18 = Panel("{-1.5,4.9,-0.4}")
pt_7 = Point(panel_18)
pt_8 = Point(panel_17)
box = Box2Pt(PointA=pt_7, PointB=pt_8, Plane=PlaneXY(0, 0, 0))
preview_9 = CustomPreview(Geometry=box, Material=ColourSwatch(SwatchColor=RGBA(255, 0, 0, 64)))

panel_19 = Panel("collision mesh (ground)")
pt_9 = Point("{-3,-3,-0.4}")
pt_10 = Point("{7,6,-0.375}")
box_2 = Box2Pt(PointA=pt_9, PointB=pt_10, Plane=PlaneXY(0, 0, 0))

# ----
# R2
panel_20 = Panel("{-1.5,-1.5,-0.4}")
pt_11 = Point("{6.0,3.1,3.4}")
pt_12 = Point(panel_20)
box_3 = Box2Pt(PointA=pt_12, PointB=pt_11, Plane=PlaneXY(0, 0, 0))
preview_10 = CustomPreview(Geometry=box_3, Material=ColourSwatch(SwatchColor=RGBA(0, 34, 255, 64)))

# ----
# R3
panel_21 = Panel("{1.7,-1.5,-0.4}")
pt_13 = Point(panel_21)
pt_14 = Point("{8.0,4.9,3.4}")
box_4 = Box2Pt(PointA=pt_13, PointB=pt_14, Plane=PlaneXY(0, 0, 0))
preview_11 = CustomPreview(Geometry=box_4, Material=ColourSwatch(SwatchColor=RGBA(255, 255, 0, 64)))

sint = SolidIntersection(BrepsA=box_3, BrepsB=box)
sdiff = SolidDifference(BrepsA=box_3, BrepsB=box)
sdiff_2 = SolidDifference(BrepsA=box, BrepsB=box_3)
sint_2 = SolidIntersection(BrepsA=sint, BrepsB=box_4)
sdiff_3 = SolidDifference(BrepsA=sint, BrepsB=box_4)
preview_12 = CustomPreview(Geometry=sint_2, Material=ColourSwatch(SwatchColor=RGBA(255, 0, 0, 64)))
preview_13 = CustomPreview(Geometry=sdiff_3, Material=ColourSwatch(SwatchColor=RGBA(255, 255, 0, 64)))
preview_14 = CustomPreview(Geometry=[sdiff, sdiff_2], Material=ColourSwatch(SwatchColor=RGBA(0, 34, 255, 64)))

license = LicenseKaramba3D()
panel_22 = Panel(license)
joint = JointKaramba3D()
pt_15 = Point()
crv = Curve()
msphere = MeshSphere(Base=pt_15, Radius="60/1000", UCount=10, VCount=20)
entwine = Entwine(
    Branch00=ColourSwatch(SwatchColor=RGB(0, 0, 0)),
    Branch01=ColourSwatch(SwatchColor=RGB(202, 87, 255)),
    FlattenInputs=True)
entwine_2 = Entwine(Branch00="3", Branch01="3", FlattenInputs=True)
preview_15 = CustomPreview(Geometry=msphere, Material=ColourSwatch(SwatchColor=RGB(4, 189, 50)))  # disabled

# ----
# draw brick volumes tangent to the curve. unique number of bricks per leg of arch.
pt_16 = Point(split_2.Positive)
height_m = Panel("0.225")
width_m = Panel("0.1125")
thickness_m = Panel("0.075")
intcrv = Interpolate(Vertices=pt_16, Degree=3, Periodic=False, KnotStyle=1)  # -> Curve, Length, Domain
len = Length(Curve=flatten(intcrv.Curve))
division_2 = Division(A=thickness_m, B=2)
division_3 = Division(A=height_m, B=2)
division_4 = Division(A=width_m, B=2)
division_5 = Division(A=len, B=thickness_m)
crv_2 = Curve(intcrv.Curve)
int_7 = Integer(graft(division_5))
divide = DivideCurve(Curve=crv_2, Count=int_7, Kinks=False)  # -> Points, Tangents, Parameters

shatter = Shatter(Curve=crv_2, Parameters=divide.Parameters)

modulus_kn_cm_2 = Panel("99999999999")
panel_23 = Panel(" model as rigid")
number = Number(modulus_kn_cm_2)
division_6 = Division(A=number, B="2.5")
matprops = MaterialPropertiesKaramba3D(
    FamilyOfMaterial="glass",
    Name="glass",
    YoungsModulus_kN_cm2=number,
    InPlaneShearModulus_kN_cm2=division_6,
    TransverseShearModulus_kN_cm2=division_6,
    SpecificWeight_kN_m3=78.5,
    CoefficientOfThermalExpansion_1_C=1.2e-05,
    TensileStrength_kN_cm2=23.5,
    CompressiveStrength_kN_cm2=-23.5,
    StrengthHypothesis="MISES",
    mode="Isotrop")
number_2 = Number(height_m)
number_3 = Number(width_m)
multiplication_3 = Multiplication(A=number_2, B=100)
multiplication_4 = Multiplication(A=number_3, B=100)
modulus_kn_cm_2_2 = Panel(multiplication_3)
modulus_kn_cm_2_3 = Panel(multiplication_4)
material = MaterialKaramba3D(matprops)
cross_section = CrossSectionKaramba3D(
    FamilyNameOfCrossSection="DefaultCroSec",
    Material=material,
    Height_cm=modulus_kn_cm_2_2,
    UpperFlangeWidth_cm=modulus_kn_cm_2_3,
    LowerFlangeWidth_cm=modulus_kn_cm_2_3,
    mode="Trapezoid")
crosec = CrossSectionKaramba3D(cross_section)

density_kn_m_3 = Panel("2400")
data_14 = Data(density_kn_m_3)
data_15 = Data(height_m)
data_16 = Data(width_m)
data_17 = Data(thickness_m)
multiplication_5 = Multiplication(A=data_15, B=data_16, C=data_17)
applied_load_kn = Panel(multiplication_5)
Z_2 = UnitZ(Factor=expr("-x", applied_load_kn))
division_7 = Division(A=Z_2, B="2")

pt_17 = Point(pt_16)
item_6 = ListItem(List=pt_17, Index=0, Wrap=True)  # -> Item, Item1, Item2

pt_18 = Point(item_6.Item2)
pt_19 = Point(item_6.Item)
crosec_2 = CrossSectionKaramba3D(crosec)
supp = SupportKaramba3D(PosInd=pt_18, menu=[buttons(off, on, on, on, off, on)])
supp_2 = SupportKaramba3D(PosInd=pt_19, menu=[buttons(on, on, on, on, off, on)])
support = SupportKaramba3D(supp_2)
support_2 = SupportKaramba3D(supp)
merge_2 = Merge(Data1=support, Data2=support_2)
support_3 = SupportKaramba3D(merge_2)
pt_20 = Point([pt_18, pt_19])
msphere_2 = MeshSphere(Base=pt_20, Radius="30/1000", UCount=10, VCount=20)
preview_16 = CustomPreview(Geometry=msphere_2, Material=ColourSwatch(SwatchColor=RGB(37, 207, 250)))  # disabled

midpt = CurveMiddle(Curve=shatter)
end = EndPoints(Curve=shatter)  # -> Start, End
pt_21 = Point(end.Start)
pt_22 = Point(end.End)
crv_3 = Curve(shatter)

crv_cp = CurveClosestPoint(Point=midpt, Curve=crv_2)  # -> Point, Parameter, Distance

pframe = PerpFrame(Curve=crv_2, Parameter=crv_cp.Parameter)  # -> simplify(Frame)
box_5 = CenterBox(Base=pframe, X=division_3, Y=division_4, Z=division_2)

pdecon = Deconstruct(Point=pframe)  # -> XComponent, YComponent, ZComponent
expression = Expression(x=pdecon.XComponent, Expression="round(x,1)")
expression_2 = Expression(x=pdecon.YComponent, Expression="round(x,1)")
expression_3 = Expression(x=pdecon.ZComponent, Expression="round(x,1)")
pt_23 = ConstructPoint(XCoordinate=expression, YCoordinate=expression_2, ZCoordinate=expression_3)
data_18 = Data(panel_2)
data_19 = Data(panel)
python_6 = GhPythonScript(x=data_18, y=data_19)  # -> path
# ---------- python_6: Python ----------
__author__ = "Edvard"
__version__ = "2023.06.19"

import rhinoscriptsyntax as rs
import os

path = os.path.join(x,y)
print path
# ---------- end python_6 ----------
data_20 = Data(dispatch_3.ListA)
data_21 = Data(dispatch_4.ListA)
data_22 = Data(python_6)
data_23 = Data(split.Positive)
pt_24 = Point(pt_23)
python_7 = GhPythonScript(points=data_20, values=data_21, path=data_22, arch_points=pt_24, arch_variables=data_23, save_data=Toggle(False))  # -> out, output; inputs points: list of Point3d, values: list, arch_points: tree of Point3d, arch_variables: tree
# ---------- python_7: Python ----------
__author__ = "Edvard"
__version__ = "2023.06.13"

import rhinoscriptsyntax as rs
import ghpythonlib.treehelpers as th

import os
import json

from collections import OrderedDict


def save_json(v,data):
    name = "a{:0>2}_w{:0>2}_r{:0>3}"
    
    angle = str(v["angle"]).split('.')[0]
    width = str(v["width"]).replace('.','')
    ratio = str(int(round(v["ratio"]*100,0))).replace('.','')
    
    
    filename = name.format(angle,width,ratio) # just take first to init
    filepath = os.path.join(path, filename)
    
    with open(filepath, "w") as f:
        json.dump(data,f,indent=4)
        f.close()

for i in range(arch_points.BranchCount):
    saved_data = OrderedDict()
    saved_variables = OrderedDict()
    
    branch_list = arch_points.Branch(i)
    
    n_total = len(branch_list)
    n_notreach = 0
    n_reach = 0
    value = 0

    for arch_point in branch_list:
        try:
            idx = points.index(arch_point)
            value += values[idx]
            
            n_reach += 1
        except:
            n_notreach += 1
    

    saved_data["bricks_total"] = n_total
    saved_data["bricks_reach"] = n_reach
    saved_data["bricks_notreach"] = n_notreach
    saved_data["reach_ratio"] = round(n_reach/n_total,2)
    saved_data["avg_reach_score"] = int(round(value/n_total,0))
    
    
    
    saved_variables["angle"] = arch_variables.Branch(i)[0]
    saved_variables["width"] = arch_variables.Branch(i)[1]
    saved_variables["ratio"] = arch_variables.Branch(i)[2]
    
    output = {
        "arch_info":saved_variables,
        "data":saved_data
        }
    
    print output
    
    if save_data:
        save_json(saved_variables, output)
# ---------- end python_7 ----------

panel_24 = Panel(python_7.out)

multiplication_6 = Multiplication(A=height_m, B="100")
multiplication_7 = Multiplication(A=width_m, B="100")
arch_thickness_cm = Panel(multiplication_6)
arch_width_cm = Panel(multiplication_7)
kn_m_3 = Panel("100000000")
kn_rad_m_2 = Panel("800000")
multiplication_8 = Multiplication(A=arch_thickness_cm, B=arch_width_cm)
division_8 = Division(A=multiplication_8, B="10000")
multiplication_9 = Multiplication(A=division_8, B=kn_rad_m_2)
multiplication_10 = Multiplication(A=division_8, B=kn_m_3)
panel_25 = Panel(division_8)
rotational_stiffness_kn_rad = Panel(multiplication_9)
panel_kn_m = Panel(multiplication_10)
has_translation_spring = BooleanToggle(True)
has_rotation_spring = BooleanToggle(True)
num_2 = Number(multiplication_10)
num_3 = Number(multiplication_9)
python_8 = GhPythonScript(
    spring_translational_stiffness=num_2,
    spring_rotational_stiffness=num_3,
    has_translation_spring=has_translation_spring,
    has_rotation_spring=has_rotation_spring)  # -> out, ct, cr, dof; inputs has_translation_spring: Boolean, has_rotation_spring: Boolean
# ---------- python_8: Python ----------
import rhinoscriptsyntax as rs

dof = []

if has_translation_spring:
    dof.extend(list(range(0, 3)))
if has_rotation_spring:
    dof.extend(list(range(3, 6)))


tras = spring_translational_stiffness
rots = spring_rotational_stiffness

ct = rs.AddPoint(tras, tras, tras)
cr = rs.AddPoint(rots, rots, rots)
# ---------- end python_8 ----------
pt_25 = Point(pt_21)
shift = ShiftList(List=pt_25, Shift=1, Wrap=False)
vec_3 = Vector(python_8.ct)
vec_4 = Vector(python_8.cr)
int_8 = Integer(python_8.dof)

pt_26 = Point(pt_21)
pt_27 = Point(pt_16)
item_7 = ListItem(List=pt_27, Index=0, Wrap=True)  # -> Item, Item1, Item2
shift_2 = ShiftList(List=pt_26, Shift=1, Wrap=False)

crv_4 = Curve(crv_3)
pt_28 = Point(shift)
vec_5 = Vector(vec_4)
int_9 = Integer(int_8)
pt_29 = Point([item_7.Item, item_7.Item2])
vec_6 = Vector(vec_3)
pt_30 = Point(shift_2)
beam_joints = BeamJointsKaramba3D(
    AtElementIdentifiers=pt_28,
    CtKNMAtStartingNode=vec_6,
    CrKNmRadAtStartingNode=vec_5,
    CtKNMAtEndNode=vec_6,
    CrKNmRadAtEndNode=vec_5,
    menu=[buttons(on, on, on, on, on, on), buttons(on, on, on, on, on, on)])
loads = LoadsKaramba3D(ForceVector=division_7, Local=False, PosInd=pt_29, LCase="0", mode="Point")
loads_2 = LoadsKaramba3D(ForceVector=Z_2, Local=False, PosInd=pt_30, LCase="0", mode="Point")
linetobeam = LineToBeamKaramba3D(
    Line=crv_4,
    CrossSection=crosec_2,
    New=True,
    Remove=True,
    LimitDistance_m=0.005,
    Bending=True,
    SetBucklingLength=True,
    ToPolylineMaxAngle=0.03,
    ToPolylineTolerance=0.01,
    ToPolylineMinEdgeLength=0.25)  # -> Element, Points, Info
panel_26 = Panel(loads)
load = LoadKaramba3D(loads)
load_2 = LoadKaramba3D(loads_2)
merge_3 = Merge(Data1=load, Data2=load_2)
joint_2 = JointKaramba3D(beam_joints)
element = ElementKaramba3D(linetobeam.Element)
element_2 = ElementKaramba3D(element)
load_3 = LoadKaramba3D(merge_3)
assemble = AssembleModelKaramba3D(Elem=flatten(element_2), Support=flatten(support_3), Load=flatten(load_3), Joint=flatten(joint), LimitDistance_m=0.005)  # -> Model, Info, Mass_kg, CenterOfGravity, LoadCaseNames
panel_27 = Panel(assemble.Mass_kg)
analyze = AnalyzeKaramba3D(Model=assemble.Model)  # -> CalculatedModel, MaximumDisplacement_cm, ResultingForceOfGravity_kN, ElasticEnergy_kNm
model = ModelKaramba3D(analyze.CalculatedModel)
num_4 = Number(analyze.MaximumDisplacement_cm)
model_2 = ModelKaramba3D(model)
react = ReactionForcesKaramba3D(AnalyzedModel=model)  # -> AnalyzedModel, ReactionForces_kN, ReactionMoments_kNm, SupportPosition, SumOfReactionForces_kN, SumOfReactionMoments_kNm
b_res_force = BeamResultantForcesKaramba3D(AnalyzedModel=model, LoadCase=-1, MaximumProbingDistance_m=-1, NumberOfProbingPointsPerElement=3)  # -> AnalyzedModel, NormalForce_kN, ResultantBendingMoment_kNm, ResultantShearForce_kN
nodedisp = NodalDisplacementsKaramba3D(AnalyzedModel=model)  # -> AnalyzedModel, NodalTranslations_m, NodalRotations_rad
modelview = ModelViewKaramba3D(Model=model, ResultFactors="100", ResultCase=-1)  # -> Model, DeformedMesh, DeformedAxes, DeformedModel
panel_28 = Panel(react.ReactionMoments_kNm)
panel_29 = Panel(react.ReactionForces_kN)
num_5 = Number(b_res_force.NormalForce_kN)
num_6 = Number(nodedisp.NodalTranslations_m)
beamview = BeamViewKaramba3D(Model=modelview.Model)  # -> Model, MeshesOfRenderedBeams, DeformedBeamAxes, LegendColors, LegendTags
panel_30 = Panel(num_5)
panel_31 = Panel(num_6)
legend = Legend(Colour=beamview.LegendColors, Tags=beamview.LegendTags, LegendType=1)
num_7 = Number(num_4)
num_8 = Number(num_5)
sort = SortList(Keys=num_8)  # -> Keys, ValuesA
avr = Average(Input=num_8)
item_8 = ListItem(List=sort.Keys, Index=0, Wrap=True)  # -> Item1, Item
max_disp_cm = Panel(num_7)
graph = QuickGraph(sort.Keys, SortOrder=0)
minforce_kn = Panel(item_8.Item)
avg_force_kn = Panel(avr)
max_force_kn = Panel(item_8.Item1)
pt_31 = Point(pt_21)
crv_5 = Curve(crv_3)
msphere_3 = MeshSphere(Base=pt_31, Radius="20/1000", UCount=10, VCount=20)
entwine_3 = Entwine(Branch00=crv_5, Branch01=crv, FlattenInputs=True)
preview_17 = CustomPreview(Geometry=msphere_3, Material=ColourSwatch(SwatchColor=RGB(250, 140, 37)))  # disabled
previewlw = CustomPreviewLineweights(Geometry=entwine_3, Shader=entwine, Thickness=entwine_2, Absolute=False)  # disabled
